# Grasshopper definition assignment-01.gh (Grasshopper 1.0.8)

# ---- group: parameters
twist_angle = Slider(85, range=0..180)
scaling = Slider(0.85, range=0.8..1)
density = Slider(0.9, range=0..1)
total_height = Slider(60, range=0..100)
derived_params = Python3Script(height=total_height, density=density, scaling=scaling, twist_angle=twist_angle)  # -> info, n_rods, rod_radii, ring_thicknesses, waists, level_colors, star_radius, radii, heights; inputs height: Double, density: Double, twist_angle: Int32
# ---------- derived_params: Python ----------
"""
derived_params -- the tower GROWS by adding levels.

RULE: one factor q = 0.85 for everything (each level is 15% smaller)
    level k:  height       h_k = h0 * q^k        (h0 = 12)
              radius       R_k = R0 * q^k        (R0 = 10)
              rod radius   r_k = r0 * q^k        (r0 = 0.25)
              ring         t_k = t0 * q^k        (t0 = 0.45)
              colour       c_k = c_top + (c_base - c_top) * q^k   (lighter to the top)
    number of levels n: as many as fit into the total height
              h_0 + h_1 + ... + h_(n-1) <= H
    natural maximum height: H_max = h0 / (1 - q) = 80
        density: rho = covered share of the ring circumference
             m = round(rho * pi * R0 / r0)   (0 = no rods, 1 = rods touch)
"""
import math
import System.Drawing as sd

H0 = 15.0                   # height of the bottom level
R0 = 10.0                   # radius of the bottom ring
ROD_R0 = 0.3                # rod radius of the bottom level
RING_T0 = 0.4               # ring thickness of the bottom ring
MAX_LEVELS = 20
C_BASE = (83, 89, 98)       # gunmetal (bottom)
C_TOP = (205, 209, 214)     # light steel (approached at the top)
STAR_REPLACES = 1           # the star replaces the last level

# density slider may be 0-1 or 0-100 (%)
rho = density / 100.0 if density > 1 else density
rho = max(0.0, min(1.0, rho))
# RULE: density = share of the ring circumference covered by rods
#   rho = m * 2r / (2 pi R)  ->  m = round(rho * pi * R / r)
#   R and r shrink with the same q -> same m on every level
#   rho = 0 -> no rods, rho = 1 -> rods touch each other
M_FULL = math.pi * R0 / ROD_R0
n_rods = int(round(rho * M_FULL))

# --- how many levels fit into the total height? ---
heights = []
total = 0.0
# RULE: a level is only added if it still fits completely
#       -> built height <= chosen total height (always)
for k in range(MAX_LEVELS):
    h_k = H0 * scaling ** k
    if total + h_k > height:
        break
    heights.append(h_k)
    total += h_k

n_fit = len(heights)                       # levels that would fit without a star
# RULE: the star replaces the last STAR_REPLACES levels
heights = heights[:max(0, n_fit - STAR_REPLACES)]
levels_height = sum(heights)
n_levels = len(heights)

# --- every dimension shrinks with the same factor ---
radii = [R0 * scaling ** k for k in range(n_levels + 1)]             # n_levels + 1 rings
rod_radii = [ROD_R0 * scaling ** k for k in range(n_levels)]
ring_thicknesses = [RING_T0 * scaling ** k for k in range(n_levels + 1)]

# RULE: the star fills the remaining height exactly -> tower + star = H
#   star height (lower tips -> top tip) = r * (1 + cos 36 deg)
#   it stands on a cap plate (thickness = top ring thickness) on the top ring
if n_levels > 0:
    remaining = height - levels_height - ring_thicknesses[n_levels]
else:
    remaining = height                          # no level: star stands on the ground
star_radius = max(0.0, remaining) / (1 + math.cos(math.radians(36)))


def level_color(k):
    f = k / float(max(n_levels, 1))          # 0 unten -> 1 ganz oben
    rgb = [int(round(C_BASE[i] + (C_TOP[i] - C_BASE[i]) * f)) for i in range(3)]
    return sd.Color.FromArgb(rgb[0], rgb[1], rgb[2])


level_colors = [level_color(k) for k in range(n_levels + 1)]


def waist_radius(R_bottom, R_top, theta_deg):
    """narrowest radius of a twisted level"""
    t = math.radians(theta_deg)
    ax, ay = R_bottom, 0.0
    bx, by = R_top * math.cos(t), R_top * math.sin(t)
    dx, dy = bx - ax, by - ay
    L2 = dx * dx + dy * dy
    if L2 < 1e-12:
        return min(R_bottom, R_top)
    s = max(0.0, min(1.0, -(ax * dx + ay * dy) / L2))
    return math.hypot(ax + s * dx, ay + s * dy)


waists = [waist_radius(radii[k], radii[k + 1], twist_angle) for k in range(n_levels)]

next_h = H0 * scaling ** n_fit      # the next level that would fit
info = "\n".join([
    "q = {}   levels: {} + star   levels height: {:.1f}   total = {:.1f}".format(
        scaling, n_levels, levels_height, height),
    "star radius: {:.2f}".format(star_radius),
    "next level appears at H = {:.1f}".format(total + next_h),
    "rho = {:.2f}   rods per direction: {}   twist = {:.0f} deg".format(rho, n_rods, twist_angle),
    "heights: " + ", ".join("{:.2f}".format(h) for h in heights),
    "radii:   " + ", ".join("{:.2f}".format(r) for r in radii),
    "waists:  " + ", ".join("{:.2f}".format(w) for w in waists),
])
# ---------- end derived_params ----------
panel = Panel(derived_params.info)

# ----
# Assignment-01: Bauhaus
path = FilePath("/Users/stefaniebretting/workspace/cdf1_teaching/src/")
autoreloader = Python3Script(src_path=path)  # -> out; inputs src_path: String
# ---------- autoreloader: Python ----------
#! python3
import sys, os, time
import scriptcontext as sc
import Rhino, System
from System.IO import FileSystemWatcher, NotifyFilters

VERSION = 1  
pkg = "cdf"

if not src_path:
    raise Exception("Connect a folder to src_path.")
path = os.path.normpath(src_path)
watch_dir = os.path.join(path, pkg)
if not os.path.isdir(watch_dir):
    raise Exception("No '{}' folder found in:\n{}".format(pkg, path))

def unload():
    for name in list(sys.modules):
        if name == pkg or name.startswith(pkg + "."):
            del sys.modules[name]

# Put this folder first in Python's search list
if path in sys.path:
    sys.path.remove(path)
sys.path.insert(0, path)

key = "cdf_watcher_" + str(ghenv.Component.InstanceGuid)
time_key = key + "_time"
version_key = key + "_version"

def stamp():
    sc.sticky[time_key] = time.strftime("%Y-%m-%d %H:%M:%S")

# Replace the old watcher if the folder changed or the script was updated
old = sc.sticky.get(key)
if old is not None and (os.path.normpath(old.Path) != watch_dir
                        or sc.sticky.get(version_key) != VERSION):
    old.Dispose()
    del sc.sticky[key]
    unload()

if key not in sc.sticky:
    comp = ghenv.Component
    last = [0.0]

    def reload_and_rerun():
        unload()
        stamp()
        doc = comp.OnPingDocument()
        if doc is None:            # reloader was deleted or the file closed
            return
        for obj in doc.Objects:
            if "Python" in obj.GetType().Name:
                obj.ExpireSolution(False)   # mark as out of date
        doc.NewSolution(False)              # recompute once

    def on_change(sender, e):
        if not e.FullPath.endswith(".py") or "__pycache__" in e.FullPath:
            return
        if time.time() - last[0] < 0.5:     # ignore the second event of a double save
            return
        last[0] = time.time()
        Rhino.RhinoApp.InvokeOnUiThread(System.Action(reload_and_rerun))

    w = FileSystemWatcher(watch_dir, "*.py")
    w.IncludeSubdirectories = True
    w.NotifyFilter = NotifyFilters.LastWrite
    w.Changed += on_change
    w.EnableRaisingEvents = True
    sc.sticky[key] = w
    sc.sticky[version_key] = VERSION
    stamp()                                  # time the watcher started

msg = "Last reloaded: {}\nWatching: {}".format(sc.sticky.get(time_key, "unknown"), watch_dir)
print(msg)
out = msg
# ---------- end autoreloader ----------
panel_2 = Panel(autoreloader)

# ---- group: tower_skeleton
tower_center = Point(Point(20, 30, 0))
tower_core = Python3Script(
    n_rods=derived_params.n_rods,
    rod_radii=derived_params.rod_radii,
    ring_thicknesses=derived_params.ring_thicknesses,
    level_colors=derived_params.level_colors,
    star_radius=derived_params.star_radius,
    radii=derived_params.radii,
    heights=derived_params.heights,
    twist_angle=twist_angle,
    center=tower_center)  # -> rods, rod_colors, rings, ring_colors, star; inputs n_rods: Int32, rod_radii: list of Double, ring_thicknesses: list of Double, level_colors: list, star_radius: Double, radii: list of Double, heights: list of Double, twist_angle: Double, center: Point3d
# ---------- tower_core: Python ----------
"""
tower_core -- stacks the levels. Each level starts where the one below ends,
and gets its own rod thickness, ring thickness and colour from derived_params.
"""
import math
import Rhino.Geometry as rg
from cdf.geometry_basics import create_rod, create_ring, create_star, create_cylinder

print("heights", len(heights))
print("radii", len(radii))
print("rod_radii", len(rod_radii))
print("ring_thicknesses", len(ring_thicknesses))
print("level_colors", len(level_colors))

class TowerLevel(object):
    """One twisted lattice level: 2 x n_rods rods + its bottom ring."""

    def __init__(self, center, z0, R_bottom, R_top, height, n_rods, theta,
                 rod_radius, ring_thickness, phase=0.0):
        self.center = center
        self.z0 = z0
        self.R_bottom = R_bottom
        self.R_top = R_top
        self.height = height
        self.n_rods = int(n_rods)
        self.theta = theta
        self.rod_radius = rod_radius
        self.ring_thickness = ring_thickness
        self.phase = phase

    @property
    def z1(self):
        return self.z0 + self.height

    def rod_endpoints(self):
        cx, cy = self.center.X, self.center.Y
        t = math.radians(self.theta)
        pairs = []
        for direction in (1, -1):
            for i in range(self.n_rods):
                a0 = self.phase + 2 * math.pi * i / self.n_rods
                a1 = a0 + direction * t
                p0 = rg.Point3d(cx + self.R_bottom * math.cos(a0),
                                cy + self.R_bottom * math.sin(a0), self.z0)
                p1 = rg.Point3d(cx + self.R_top * math.cos(a1),
                                cy + self.R_top * math.sin(a1), self.z1)
                pairs.append((p0, p1))
        return pairs

    def build_rods(self):
        return [create_rod(p0, p1, self.rod_radius) for p0, p1 in self.rod_endpoints()]

    def build_bottom_ring(self):
        c = rg.Point3d(self.center.X, self.center.Y, self.z0)
        return create_ring(c, self.R_bottom, self.ring_thickness)


if center is None:
    center = rg.Point3d(0, 0, 0)

if not heights:
    heights = []

rods, rings, rod_colors, ring_colors = [], [], [], []
z0 = center.Z

for k in range(len(heights)):
    level = TowerLevel(center, z0, radii[k], radii[k + 1], heights[k], n_rods,
                       twist_angle, rod_radii[k], ring_thicknesses[k],
                       phase=(k * math.pi / n_rods) if n_rods > 0 else 0.0)
    level_rods = level.build_rods()
    rods.extend(level_rods)
    rod_colors.extend([level_colors[k]] * len(level_rods))     # one colour per rod
    rings.append(level.build_bottom_ring())
    ring_colors.append(level_colors[k])
    z0 = level.z1                                              # next level rests on this one

# closing ring on top (only if at least one level exists)
n = len(heights)
if n > 0:
    rings.append(create_ring(rg.Point3d(center.X, center.Y, z0), radii[n], ring_thicknesses[n]))
    ring_colors.append(level_colors[n])

# cap plate + star on top
star = None
if star_radius > 0:
    if n > 0:
        t = ring_thicknesses[n]
        # cap plate closes the top ring -> the star stands on it
        cap = create_cylinder(base_point=rg.Point3d(center.X, center.Y, z0),
                              height=t, radius=radii[n])
        rings.append(cap)
        ring_colors.append(level_colors[n])
        z_base = z0 + t
        star_thickness = 2 * t
    else:
        z_base = center.Z                       # no level: star on the ground
        star_thickness = 2 * ring_thicknesses[0]

    # lower tips lie r*cos(36 deg) below the center -> they touch z_base
    z_star = z_base + star_radius * math.cos(math.radians(36))
    star = create_star(
        center=rg.Point3d(center.X, center.Y, z_star),
        outer_radius=star_radius,
        inner_radius=0.382 * star_radius,
        n_points=5,
        thickness=star_thickness,
    )
# ---------- end tower_core ----------
preview = CustomPreview(Geometry=tower_core.rods, Material=tower_core.rod_colors)
preview_2 = CustomPreview(Geometry=tower_core.rings, Material=tower_core.ring_colors)
preview_3 = CustomPreview(Geometry=tower_core.star, Material=ColourSwatch(SwatchColor=RGB(29, 97, 177)))

# ---- group: platforms
platforms = Python3Script(
    center=tower_center,
    radii=derived_params.radii,
    heights=derived_params.heights,
    scaling=scaling,
    twist_angle=twist_angle)  # -> plate_radii, centers_a, centers_b, plates_a, colors_a, plates_b, colors_b, info; inputs center: Point3d, radii: list of Double, heights: list of Double, scaling: Double, twist_angle: Double
# ---------- platforms: Python ----------
"""
platforms -- two spirals of plates climbing around the lattice tower.

RULES
    per level:      N_PER_LEVEL = 3 platforms per spiral (constant)
                    -> spacing h_k / 3 shrinks with the scaling factor automatically
    height:         z = z0_k + s * h_k,   s = (p + 0.5) / 3
    shrinking:      f_size = scaling^(k + s)      (same factor as the levels)
    size:           r_p = 0.45 * R0 * f_size
    thickness:      t   = 0.06 * R0 * f_size,  but t <= 0.4 * spacing
    twist:          each step turns twist / 3     -> one level = one twist (like the rods)
    second spiral:  +180 deg                      -> balance, COG on the axis
    surface:        plate centre at r_tower(z) + 0.6 r_p
                    notch = plate - cylinder(r_tower(z)) -> plate hugs the lattice
    colour:         same rule as the tower: f = (k + s) / n_levels,
                    dark at the bottom -> light at the top
"""
import math
import Rhino.Geometry as rg
import System.Drawing as sd
from cdf.geometry_basics import create_cylinder, boolean_difference

N_PER_LEVEL = 3             # platforms per spiral per level
P_RATIO = 0.45              # platform radius / base radius
T_RATIO = 0.06              # platform thickness / base radius
OVERLAP = 0.4               # part of the platform reaching into the tower (cut away)

# colours: (bottom, top) for each spiral
A_BASE, A_TOP = (165, 38, 30), (240, 175, 165)      # red  -> light red
B_BASE, B_TOP = (25, 62, 128), (175, 198, 235)      # blue -> light blue


def radius_at(R_bottom, R_top, theta_deg, s):
    """radius of the lattice surface at relative height s (0..1) within a level"""
    t = math.radians(theta_deg)
    x = (1 - s) * R_bottom + s * R_top * math.cos(t)
    y = s * R_top * math.sin(t)
    return math.hypot(x, y)


def shade(base, top, f):
    """same colour rule as the tower: f = 0 bottom -> f = 1 top"""
    f = max(0.0, min(1.0, f))
    rgb = [int(round(base[i] + (top[i] - base[i]) * f)) for i in range(3)]
    return sd.Color.FromArgb(rgb[0], rgb[1], rgb[2])


if center is None:
    center = rg.Point3d(0, 0, 0)

plates_a, plates_b, colors_a, colors_b = [], [], [], []
centers_a, centers_b, plate_radii = [], [], []      # stations for the marble run

if heights:
    n_levels = len(heights)
    R0 = radii[0]
    dphi = math.radians(twist_angle) / N_PER_LEVEL
    z0 = center.Z
    j = 0                                           # running step along the spiral

    for k in range(n_levels):
        h_k = heights[k]
        spacing = h_k / N_PER_LEVEL
        for p in range(N_PER_LEVEL):
            s = (p + 0.5) / N_PER_LEVEL
            z = z0 + s * h_k
            f_size = scaling ** (k + s)             # continuous shrinking
            f_col = (k + s) / n_levels              # continuous colour step
            r_tower = radius_at(radii[k], radii[k + 1], twist_angle, s)
            r_p = P_RATIO * R0 * f_size
            t = min(T_RATIO * R0 * f_size, 0.4 * spacing)

            for offset, plates, colors, centers, base, top in (
                    (0.0, plates_a, colors_a, centers_a, A_BASE, A_TOP),
                    (math.pi, plates_b, colors_b, centers_b, B_BASE, B_TOP)):
                ang = j * dphi + offset
                d = r_tower + (1 - OVERLAP) * r_p
                c = rg.Point3d(center.X + d * math.cos(ang),
                               center.Y + d * math.sin(ang), z - t / 2)
                plate = create_cylinder(base_point=c, height=t, radius=r_p)

                # notch: remove the part inside the tower surface
                cutter = create_cylinder(base_point=rg.Point3d(center.X, center.Y, z - t),
                                         height=2 * t, radius=r_tower)
                result = boolean_difference(plate, cutter)
                if result:
                    plate = result[0]

                plates.append(plate)
                colors.append(shade(base, top, f_col))
                centers.append(rg.Point3d(c.X, c.Y, z + t / 2))   # top surface centre
            plate_radii.append(r_p)
            j += 1
        z0 += h_k

info = "platforms: {} per spiral per level, total {}   angle step: {:.1f} deg".format(
    N_PER_LEVEL, len(plates_a) + len(plates_b), twist_angle / N_PER_LEVEL)
# ---------- end platforms ----------
panel_3 = Panel(platforms.info)
preview_4 = CustomPreview(Geometry=platforms.plates_a, Material=platforms.colors_a)
preview_5 = CustomPreview(Geometry=platforms.plates_b, Material=platforms.colors_b)

# ---- group: time
time_steps = Slider(0.01, range=0.002..0.02)
trigger = Trigger(Interval=100, TimerInterval=100, Target=clock)  # disabled
running = BooleanToggle(True)
reset = Button()
clock = Python3Script(run=running, reset=reset, step=time_steps)  # -> out, time; inputs run: Boolean, reset: Boolean, step: Double
# ---------- clock: Python ----------
"""
clock -- advances time in constant steps (simulated real time).
Each run of the block (triggered by the Timer) adds 'step'.
At 1.0 it starts again at 0 (loop).
"""
import scriptcontext as sc

key = "marble_clock_" + str(ghenv.Component.InstanceGuid)

if reset or key not in sc.sticky:
    sc.sticky[key] = 0.0

if run:
    t = sc.sticky[key] + step
    if t > 1.0:
        t = 0.0                     # loop: start again at the top
    sc.sticky[key] = t

time = sc.sticky[key]
# ---------- end clock ----------

# ---- group: marbles
marble_physics = Python3Script(
    center=tower_center,
    plate_radii=platforms.plate_radii,
    centers_a=platforms.centers_a,
    centers_b=platforms.centers_b,
    time=clock.time)  # -> out, path_a, path_b, marble_a, marble_b, ghosts, bowls, info; inputs center: Point3d, plate_radii: list of Double, centers_a: list of Point3d, centers_b: list of Point3d, time: Double
# ---------- marble_physics: Python ----------
"""
marble_physics -- the marbles roll over each platform, drop off its edge in a
free-fall arc onto the next platform, and finally fall into a catch bowl.

RULES
  marble:   r_m = 0.2 * smallest platform radius
  start:    small push  v0 = 0.5 * sqrt(2 g r_m)
  rolling:  on a flat platform the marble keeps its horizontal speed v (no friction),
            from its landing point to the edge facing the next platform
  falling:  free fall from the edge:  x = v t,  z = -1/2 g t^2
            fall time  T = sqrt(2 dz / g)
  landing:  the platform absorbs the vertical speed, the horizontal speed v remains;
            the landing point must lie on the next platform (else: moved onto its rim)
  bowl:     on the last platform the marble keeps its direction of travel
"""

import math
import Rhino.Geometry as rg
from cdf.geometry_basics import create_sphere, create_bowl

G = 9.81
PUSH = 0.5                  # start push as a fraction of sqrt(2 g r_m)
M_RATIO = 0.2               # marble radius / smallest platform radius
BOWL_RATIO = 2.5            # bowl inner radius / marble radius
WALL = 0.15                 # bowl wall thickness / bowl inner radius
N_ROLL = 20                 # samples per rolling phase
N_FALL = 30                 # samples per falling phase
N_GHOSTS = 24               # stroboscope images

if center is None:
    center = rg.Point3d(0, 0, 0)


def hdir(a, b):
    """horizontal unit vector from a to b"""
    v = rg.Vector3d(b.X - a.X, b.Y - a.Y, 0)
    if v.Length < 1e-9:
        v = rg.Vector3d(1, 0, 0)
    v.Unitize()
    return v


def hdist(a, b):
    return math.hypot(a.X - b.X, a.Y - b.Y)


def build_path(stations, r_ps, r_m, v):
    """sampled marble positions + the time at which each is reached"""
    C = list(reversed(stations))                 # platform top centres, top -> bottom
    R = list(reversed(r_ps))
    n = len(C)
    pts, times = [], []

    def add(p, dt):
        times.append(times[-1] + dt if times else 0.0)
        pts.append(p)

    R_in = BOWL_RATIO * r_m
    R_out = R_in * (1 + WALL)
    pos = rg.Point3d(C[0].X, C[0].Y, C[0].Z + r_m)   # start: middle of the top platform
    add(pos, 0.0)
    
    d_prev = None                                    # direction of the previous fall

    for i in range(n):
        z_ball = C[i].Z + r_m
        # roll towards the next platform (last one: radially outward, away from the tower)
        if i < n - 1:
            d = hdir(C[i], C[i + 1])                 # roll towards the next platform
        elif d_prev is not None:
            d = d_prev                               # last platform: keep the direction of travel
        else:
            d = hdir(center, C[i])                   # only one platform: roll outward
        edge = rg.Point3d(C[i].X + d.X * R[i], C[i].Y + d.Y * R[i], z_ball)

        # 1) ROLLING: constant horizontal speed v
        L = hdist(pos, edge)
        for s in range(1, N_ROLL + 1):
            f = s / float(N_ROLL)
            add(rg.Point3d(pos.X + (edge.X - pos.X) * f, pos.Y + (edge.Y - pos.Y) * f, z_ball),
                (L / N_ROLL) / v)

        # 2) FALLING: free fall to the next platform (or into the bowl)
        if i < n - 1:
            z_land = C[i + 1].Z + r_m
        else:
            z_land = center.Z + (R_out - R_in) + r_m        # inner bottom of the bowl
        dz = max(z_ball - z_land, 1e-6)
        T = math.sqrt(2 * dz / G)
        land = rg.Point3d(edge.X + d.X * v * T, edge.Y + d.Y * v * T, z_land)

        if i < n - 1:                                       # must land ON the next platform
            off = hdist(land, C[i + 1])
            lim = R[i + 1] - r_m
            if off > lim:
                k = lim / off
                land = rg.Point3d(C[i + 1].X + (land.X - C[i + 1].X) * k,
                                  C[i + 1].Y + (land.Y - C[i + 1].Y) * k, z_land)

        for s in range(1, N_FALL + 1):
            f = s / float(N_FALL)
            t = T * f
            z = z_ball - 0.5 * G * t * t if s < N_FALL else z_land
            add(rg.Point3d(edge.X + (land.X - edge.X) * f, edge.Y + (land.Y - edge.Y) * f, z),
                T / N_FALL)
        pos = land
        d_prev = d

    # bowl exactly where the marble ends up
    bowl_center = rg.Point3d(pos.X, pos.Y, pos.Z - r_m + R_in)
    bowl = create_bowl(bowl_center, R_in, R_out)
    return pts, times, bowl


def position_at(pts, times, T):
    if T >= times[-1]:
        return pts[-1]
    for i in range(1, len(times)):
        if times[i] >= T:
            f = (T - times[i - 1]) / (times[i] - times[i - 1])
            a, b = pts[i - 1], pts[i]
            return rg.Point3d(a.X + (b.X - a.X) * f, a.Y + (b.Y - a.Y) * f, a.Z + (b.Z - a.Z) * f)
    return pts[-1]


marble_a = marble_b = path_a = path_b = None
ghosts, bowls = [], []
info = "not enough platforms"

if centers_a and len(centers_a) >= 2:
    r_m = M_RATIO * min(plate_radii)
    v = PUSH * math.sqrt(2 * G * r_m)

    pts_a, times_a, bowl_a = build_path(centers_a, plate_radii, r_m, v)
    pts_b, times_b, bowl_b = build_path(centers_b, plate_radii, r_m, v)
    bowls = [b for b in (bowl_a, bowl_b) if b]
    path_a = rg.Polyline(pts_a).ToNurbsCurve()
    path_b = rg.Polyline(pts_b).ToNurbsCurve()

    T_total = max(times_a[-1], times_b[-1])
    T = max(0.0, min(1.0, time)) * T_total
    marble_a = create_sphere(position_at(pts_a, times_a, T), r_m)
    marble_b = create_sphere(position_at(pts_b, times_b, T), r_m)

    # stroboscope: equal time steps -> growing gaps in the falls = acceleration
    for i in range(N_GHOSTS + 1):
        Ti = T_total * i / N_GHOSTS
        ghosts.append(create_sphere(position_at(pts_a, times_a, Ti), r_m * 0.8))
        ghosts.append(create_sphere(position_at(pts_b, times_b, Ti), r_m * 0.8))

    info = "\n".join([
        "platforms per spiral: {}   marble radius: {:.2f}   push v0: {:.2f}".format(
            len(centers_a), r_m, v),
        "run time A: {:.2f}   B: {:.2f}   now: {:.2f}".format(times_a[-1], times_b[-1], T),
    ])
# ---------- end marble_physics ----------
panel_4 = Panel(marble_physics.info)
preview_6 = CustomPreview(Geometry=marble_physics.bowls, Material=ColourSwatch(SwatchColor=RGB(209, 198, 184)))
preview_7 = CustomPreview(Geometry=marble_physics.marble_a, Material=ColourSwatch(SwatchColor=RGB(247, 25, 48)))
preview_8 = CustomPreview(Geometry=marble_physics.ghosts, Material=ColourSwatch(SwatchColor=RGB(230, 190, 96)))
preview_9 = CustomPreview(Geometry=marble_physics.marble_b, Material=ColourSwatch(SwatchColor=RGB(17, 51, 255)))
